# Grasshopper definition blocks_viz_01.gh (Grasshopper 1.0.7)

# Import your base curve
crv = Curve(<curve referenced from the Rhino model>)
# Create a dataset
number_slider = Slider(6, range=0..10)
# Use data to manipulate geometry
Z = UnitZ(Factor=number_slider)
extr = Extrude(Base=crv, Direction=Z)
cap = CapHoles(Brep=extr)
# Customize visualization
swatch = ColourSwatch(SwatchColor=RGB(0, 129, 209))
preview = CustomPreview(Geometry=cap, Material=swatch)
